# Grasshopper definition sendcommands.gh (Grasshopper 1.0.7)

pt = Point(Point(0.6, -0.13, 0.8))
path = FilePath("C:\Users\ed\uibk.ac.at\E-Mail - UR_Interfaces\RCv1\")
pt_2 = Point(Point(0.6, -0.13, 0.4))
xy = XYPlane(Origin=pt)
xy_2 = XYPlane(Origin=pt_2)
python = GhPythonScript(y=path)  # -> out, a
# ---------- python: Python ----------
__author__ = "ed"
__version__ = "2021.05.19"

import rhinoscriptsyntax as rs
import json


file_name = ghenv.Component.OnPingDocument().FilePath
print(file_name)
print(file_name[:-15])

floc =y
filename="coords.json"
location=floc+filename
print(floc+filename)

data={}
try:
    with open(location) as write_file:
        data=json.load(write_file)


except:
    print("couldnt load file, creating new one")
    data={}
    data["commands"]= []
    with open(location,"w") as write_file:
        json.dump(data,write_file)

if data=={}:
    data["commands"]= []

if data["commands"]==[]or True:
    
    data["commands"].append({
    "command":"movel(p[0.6, -.13, 0.4,0.0,0.0,0], a=1, v=1, t=0, r=0)"+"\n","commandtype":"urscript"})
    
    data["commands"].append({
    "command":"movel(p[0.6, -.2, 0.8,0.0,0.0,0], a=1, v=1, t=0, r=0)" + "\n","commandtype":"urscript"})
    
    data["commands"].append({
    "command":255,"commandtype":"gripper"})
    
    
    data["commands"].append({
    "command":"movel(p[0.6, -.13, 0.4,0.0,0.0,0], a=1, v=1, t=0, r=0)\n","commandtype":"urscript"})
    
    
    data["commands"].append({
    "command":0,"commandtype":"gripper"})
    
    
    data["commands"].append({
    "command":"movel(p[0.6, -.13, 0.8,0.0,0.0,0], a=1, v=1, t=0, r=0)" + "\n","commandtype":"urscript"
    })
    with open(location,"w") as write_file:
        json.dump(data,write_file)
# ---------- end python ----------

# ---- group: movej
c_script = CSharpScript()  # -> out, CommandOut; inputs TargetPlanes: Plane
# ---------- c_script: C# ----------
    double X = TargetPlanes.OriginX;
    double Y = TargetPlanes.OriginY;
    double Z = TargetPlanes.OriginZ;


    Rhino.Geometry.Point3d center_point = new Rhino.Geometry.Point3d(0, 0, 0);
    Rhino.Geometry.Point3d height_point = new Rhino.Geometry.Point3d(0, 0, 1);
    Rhino.Geometry.Vector3d zaxis = height_point - center_point;
    Rhino.Geometry.Plane plane = new Rhino.Geometry.Plane(center_point, zaxis);

    //A = plane;

    Rhino.Geometry.Transform trans = Rhino.Geometry.Transform.PlaneToPlane(TargetPlanes, plane);

    //A = trans;


    double Rx = Math.Atan2(trans.M21, trans.M22);
    double Ry = -Math.Atan2(trans.M20, Math.Sqrt(trans.M21 * trans.M21 + trans.M22 * trans.M22));
    double Rz = Math.Atan2(trans.M10, trans.M00);


    string FinishedCommand = "movej(p[" + X + "," + Y + "," + Z + "," + Rx + "," + Ry + "," + Rz + "], a=0.6, v=0.1, t=0, r=0)" + "\n";

    CommandOut = FinishedCommand;
# ---------- end c_script ----------

# ----
xz = XZPlane(Origin=Point(0, 0, 0))
xz_2 = XZPlane(Origin=pt_2)

# ---- group: movel
c_script_2 = CSharpScript(TargetPlanes=xz_2)  # -> out, CommandOut; inputs TargetPlanes: Plane
# ---------- c_script_2: C# ----------
    double X = TargetPlanes.OriginX;
    double Y = TargetPlanes.OriginY;
    double Z = TargetPlanes.OriginZ;


    Rhino.Geometry.Point3d center_point = new Rhino.Geometry.Point3d(0, 0, 0);
    Rhino.Geometry.Point3d height_point = new Rhino.Geometry.Point3d(0, 0, 1);
    Rhino.Geometry.Vector3d zaxis = height_point - center_point;
    Rhino.Geometry.Plane plane = new Rhino.Geometry.Plane(center_point, zaxis);

    //A = plane;

    Rhino.Geometry.Transform trans = Rhino.Geometry.Transform.PlaneToPlane(TargetPlanes, plane);

    //A = trans;


    double Rx = Math.Atan2(trans.M21, trans.M22);
    double Ry = -Math.Atan2(trans.M20, Math.Sqrt(trans.M21 * trans.M21 + trans.M22 * trans.M22));
    double Rz = Math.Atan2(trans.M10, trans.M00);


    string FinishedCommand = "movel(p[" + X + "," + Y + "," + Z + "," + Rx + "," + Ry + "," + Rz + "], a=0.6, v=0.1, t=0, r=0)" + "\n" ;

    CommandOut = FinishedCommand;
# ---------- end c_script_2 ----------

# ----
panel = Panel("grippercomand")

# ---- group: movel
c_script_3 = CSharpScript(TargetPlanes=xy)  # -> out, CommandOut; inputs TargetPlanes: Plane
# ---------- c_script_3: C# ----------
    double X = TargetPlanes.OriginX;
    double Y = TargetPlanes.OriginY;
    double Z = TargetPlanes.OriginZ;


    Rhino.Geometry.Point3d center_point = new Rhino.Geometry.Point3d(0, 0, 0);
    Rhino.Geometry.Point3d height_point = new Rhino.Geometry.Point3d(0, 0, 1);
    Rhino.Geometry.Vector3d zaxis = height_point - center_point;
    Rhino.Geometry.Plane plane = new Rhino.Geometry.Plane(center_point, zaxis);

    //A = plane;

    Rhino.Geometry.Transform trans = Rhino.Geometry.Transform.PlaneToPlane(TargetPlanes, plane);

    //A = trans;


    double Rx = Math.Atan2(trans.M21, trans.M22);
    double Ry = -Math.Atan2(trans.M20, Math.Sqrt(trans.M21 * trans.M21 + trans.M22 * trans.M22));
    double Rz = Math.Atan2(trans.M10, trans.M00);


    string FinishedCommand = "movel(p[" + X + "," + Y + "," + Z + "," + Rx + "," + Ry + "," + Rz + "], a=0.6, v=0.1, t=0, r=0)" + "\n";

    CommandOut = FinishedCommand;
# ---------- end c_script_3 ----------

# ----
concat = Concatenate(FragmentA=c_script_2.CommandOut, FragmentB=";urscript")
concat_2 = Concatenate(FragmentA=c_script_3.CommandOut, FragmentB=";urscript")
concat_3 = Concatenate(FragmentA=Slider(0, range=0..255), FragmentB=";gripper")
concat_4 = Concatenate(FragmentA=Slider(146, range=0..255), FragmentB=";gripper")
concat_5 = Concatenate(FragmentA=Slider(208, range=0..255), FragmentB=";gripper")
merge = Merge(Data1=concat, Data2=concat_2, Data3=concat_3, Data4=concat_5, Data5=concat_4)
merge_2 = Merge(Data3=concat_3, Data4=concat_5, Data5=concat_4)
python_2 = GhPythonScript(command_list=merge_2, file_location=path, run=Button(), stop=Button())  # -> out, a; inputs command_list: list
# ---------- python_2: Python ----------
__author__ = "ed"
__version__ = "2021.05.19"

import rhinoscriptsyntax as rs
import json


file_name = ghenv.Component.OnPingDocument().FilePath
print(file_name)
print(file_name[:-15])

floc =file_location
filename="coords.json"
location=floc+filename
print(floc+filename)

data={}

if (run==True):
    
    try:
        with open(location) as write_file:
            data=json.load(write_file)
    
    except:
        print("couldnt load file, creating new one")
        data={}
        data["commands"]= []
        with open(location,"w") as write_file:
            json.dump(data,write_file)
    
    if data=={}:
        data["commands"]= []
    
    if data["commands"]==[]or True:
        
        for comp in command_list:
            x1,x2=comp.split(";")
            data["commands"].append({"command": x1,"commandtype": x2})
            
        with open(location,"w") as write_file:
            json.dump(data,write_file)
    
    
if stop:    
    data={}
    data["commands"]= []
    
    with open(location,"w") as write_file:
        json.dump(data,write_file)
# ---------- end python_2 ----------
python_3 = GhPythonScript(x=merge, y=path)  # -> out, a; inputs x: list
# ---------- python_3: Python ----------
__author__ = "ed"
__version__ = "2021.05.19"

import rhinoscriptsyntax as rs
import json


data={}
data["commands"]=[]
    
for comp in x:
    x1,x2=comp.split(";")
    data["commands"].append({"command": x1,"commandtype": x2})


print(data)
# ---------- end python_3 ----------
