# Grasshopper definition sendcommands_02.gh (Grasshopper 1.0.7)

geo = Geometry([<curve referenced from the Rhino model> x2, <point referenced from the Rhino model>, <brep referenced from the Rhino model>])
geo_2 = Geometry([<curve referenced from the Rhino model> x2, <point referenced from the Rhino model>, <brep referenced from the Rhino model>])
geo_3 = Geometry([<brep referenced from the Rhino model>, <point referenced from the Rhino model>, <curve referenced from the Rhino model> x2])
# Python Installation How-To:
# 
# 1. Download python 3 or higher
# 2. Make sure to check "add python3 to path" during installation
# Python How-To:
# 
# open Windows Powershell
# navigate to path using cd and " "
# example: cd "C:\Users\nicolas\OneDrive - uibk.ac.at\PhD\UR_Interfaces\Rcv1_Student"
# open file with python
# example: python3 (or python) rc_master2.py
# Grasshopper How-To:
# 
# 1. Double click on Canvas
# 2. Type "geo" and select geometry container from list
# 3. Click on the Rhino group you want to reference
# 4. Right click on geometry container and select "Set Multiple Geometries"
# 5. Plug the containers into the merge node in the right order
geo_4 = Geometry([<curve referenced from the Rhino model> x2, <point referenced from the Rhino model>, <brep referenced from the Rhino model>])

# ---- group: Plug in your Geometry Containers here!!!
merge = Merge(Data1=geo_4, Data2=geo, Data3=geo_2, Data4=geo_3)

# ---- group: Adjust Z Offset here!!!
offset_in_mm = Slider(402, range=0..1000)

# ---- group: groups to planes
cluster = Cluster(geo=merge)  # -> graft(plane)

# ---- group: close gripper
concat = Concatenate(FragmentA=Slider(255, range=0..255), FragmentB=";gripper")

# ---- group: open gripper
concat_2 = Concatenate(FragmentA=Slider(0, range=0..255), FragmentB=";gripper")

# ---- group: Z Offset
Z = UnitZ(Factor=offset_in_mm)
move = Move(Geometry=cluster, Motion=Z)  # -> Geometry, Transform
merge_2 = Merge(Data1=move.Geometry, Data2=cluster, Data3=move.Geometry)  # -> flatten(Result)

# ----
lng = ListLength(List=flatten(cluster))
merge_3 = Merge(Data1=concat, Data2=concat_2, Data3=concat)
repeat = RepeatData(Data=graft(merge_3), Length=lng)  # -> simplify(Data)

# ---- group: Adjust speed here!!!
number_slider = Slider(0.2, range=0.01..1)

# ----
# D:\OneDrive - uibk.ac.at\Methoden der Materialisierung\Rcv1_Student\
flip = FlipMatrix(Data=repeat)  # -> flatten(Data)

# ---- group: Use this to check if you have the right order!!!
number_slider_2 = Slider(0, range=0..100)
item = ListItem(List=merge_2, Index=number_slider_2, Wrap=True)
item_2 = ListItem(List=flip, Index=number_slider_2, Wrap=True)
preview = CustomPreview(
    Geometry=item,
    Material={diffuse=RGB(221, 160, 221), emission=RGB(66, 48, 66), shine=0.5, specular=RGB(255, 255, 255), transparency=0})
panel = Panel(item_2)

# ---- group: movel
# rc_master_UI2.exe
# coords.json
# record_configuration.xml
# 
# Müssen im gleichen Ordner sein!
c_script = CSharpScript(TargetPlanes=merge_2, speed=number_slider)  # -> out, CommandOut; inputs TargetPlanes: Plane, speed: Double
# ---------- c_script: C# ----------
    double velocity = speed;

    double X = TargetPlanes.OriginX / 1000;
    double Y = TargetPlanes.OriginY / 1000;
    double Z = TargetPlanes.OriginZ / 1000;


    Rhino.Geometry.Point3d center_point = new Rhino.Geometry.Point3d(0, 0, 0);
    Rhino.Geometry.Point3d height_point = new Rhino.Geometry.Point3d(0, 0, 1);
    Rhino.Geometry.Vector3d zaxis = height_point - center_point;
    Rhino.Geometry.Plane plane = new Rhino.Geometry.Plane(center_point, zaxis);

    //A = plane;

    Rhino.Geometry.Transform trans = Rhino.Geometry.Transform.PlaneToPlane(TargetPlanes, plane);

    //A = trans;


    double Rx = Math.Atan2(trans.M21, trans.M22) * -1;
    double Ry = -Math.Atan2(trans.M20, Math.Sqrt(trans.M21 * trans.M21 + trans.M22 * trans.M22));
    double Rz = Math.Atan2(trans.M10, trans.M00) * -1;


    string FinishedCommand = "movel(p[" + X + "," + Y + "," + Z + "," + Rx + "," + Ry + "," + Rz + "], a=0.6, v=" + velocity + ", t=0, r=0)" + "\n" + ";urscript";

    CommandOut = FinishedCommand;
# ---------- end c_script ----------

# ----
weave = Weave(Pattern=[1, 0], Stream0=c_script.CommandOut, Stream1=flip, NullGaps=False)

# ---- group: run
button = Button()

# ---- group: stop
button_2 = Button()

# ----
path = FilePath("C:\Users\ed\uibk.ac.at\E-Mail - UR_Interfaces\RCv1\")
python = GhPythonScript(command_list=weave, file_location=path, run=button, stop=button_2)  # -> out, a; inputs command_list: list
# ---------- python: Python ----------
__author__ = "ed"
__version__ = "2021.05.19"

import rhinoscriptsyntax as rs
import json


file_name = ghenv.Component.OnPingDocument().FilePath
print(file_name)
print(file_name[:-15])

floc =file_location
filename="coords.json"
location=floc+filename
print(floc+filename)

data={}

if (run==True):
    
    try:
        with open(location) as write_file:
            data=json.load(write_file)
    
    except:
        print("couldnt load file, creating new one")
        data={}
        data["commands"]= []
        with open(location,"w") as write_file:
            json.dump(data,write_file)
    
    if data=={}:
        data["commands"]= []
    
    if data["commands"]==[]or True:
        
        for comp in command_list:
            x1,x2=comp.split(";")
            data["commands"].append({"command": x1,"commandtype": x2})
            
        with open(location,"w") as write_file:
            json.dump(data,write_file)
    
    
if stop:    
    data={}
    data["commands"]= []
    
    with open(location,"w") as write_file:
        json.dump(data,write_file)
# ---------- end python ----------

# ==== cluster Cluster
geo = ClusterInput()  # Geo
geo_2 = Geometry(geo)
panel = Panel(geo_2)
expression = Expression(x=panel, Expression="if(x = \"Referenced Line-like Curve\", True, False)")
expression_2 = Expression(x=panel, Expression="if(x = \"Referenced Brep\", True, False)")
expression_3 = Expression(x=panel, Expression="if(x = \"Referenced Point\", True, False)")
cull = CullPattern(List=geo_2, CullPattern=expression_3)  # -> simplify(graft(List))
cull_2 = CullPattern(List=geo_2, CullPattern=expression_2)
cull_3 = CullPattern(List=geo_2, CullPattern=expression)
partition = PartitionList(List=cull_3, Size="2")
len = Length(Curve=partition)
sort = SortList(Keys=len, ValuesA=partition)  # -> reverse(Keys), reverse(ValuesA)
item = ListItem(List=sort.ValuesA, Index=0, Wrap=True)  # -> Item, Item1
pl = ConstructPlane(Origin=cull, XAxis=item.Item, YAxis=item.Item1)  # -> flatten(Plane)
plane = ClusterOutput(pl)  # Plane
